% Simulink data dictionary lib_IronAir.sldd

IronAir = struct(
  Cell=struct(A=0.01, Nx=5),
  Electrolyte=struct(
    Nx=5,
    L=0.002,
    D_OH=2.0e-9,
    E_act_D=15000,
    R=8.314462618,
    T=298.15,
    T_ref=298.15,
    t_plus=0.7,
    F=96485.3321,
    a_v=1000,
    eps_elyte=0.4,
    kappa0=40,
    c0=6000,
    c_init=repmat(6000, 5, 1)),
  Metal=struct(
    E0_Fe=-0.88,
    E0_cell=1.28,
    c_OH_ref=6000,
    i0_Fe=50,
    E_act_Fe=30000,
    T_ref=298.15,
    alpha_a=0.5,
    alpha_c=0.5,
    Q_max=7200000000,
    u_init=1),
  ORR=struct(
    Nx=5,
    L=0.001,
    D_O2=1.0e-9,
    i0_ORR=80,
    E_act_ORR=40000,
    T_ref=298.15,
    alpha_c=0.5,
    c_O2_ref=1,
    c_O2_amb=1.2,
    k_gas=0.1,
    a_v=2000,
    c_init=repmat(1, 5, 1)),
  OER=struct(i0_OER=40, E_act_OER=50000, T_ref=298.15, alpha_a=0.5),
  H2=struct(i0_H2=0.05, E_act_H2=35000, T_ref=298.15, alpha_H2=0.5, A=0.01),
  Thermal=struct(
    Nx=1,
    L=0.01,
    k_th=5,
    rho=2000,
    cp=800,
    Vol=0.0001,
    h_conv=10,
    A_surf=0.02,
    T_amb=298.15,
    m_th=0.2,
    T_init=298.15),
  Stack=struct(nSeries=10, nParallel=1),
  Module=struct(nSeries=2, nParallel=2),
  Pack=struct(nSeries=5, nParallel=4),
  Plant=struct(eta_pcs=0.96, t_end_h=48, P_nom_W=5000),
  Standards=struct(
    V_min_pu=0.88,
    V_max_pu=1.1,
    f_min_Hz=58.5,
    f_max_Hz=61.5,
    T_min_K=273.15,
    T_max_K=333.15,
    H2_max_m3=0.05,
    SOC_min=0.05,
    SOC_max=0.95,
    P_max_W=5500),
  CellBundle=struct(
    A=0.01,
    Electrolyte=struct(
      Nx=5,
      L=0.002,
      D_OH=2.0e-9,
      E_act_D=15000,
      R=8.314462618,
      T=298.15,
      T_ref=298.15,
      t_plus=0.7,
      F=96485.3321,
      a_v=1000,
      eps_elyte=0.4,
      kappa0=40,
      c0=6000,
      c_init=repmat(6000, 5, 1)),
    Metal=struct(
      E0_Fe=-0.88,
      E0_cell=1.28,
      c_OH_ref=6000,
      i0_Fe=50,
      E_act_Fe=30000,
      T_ref=298.15,
      alpha_a=0.5,
      alpha_c=0.5,
      Q_max=7200000000,
      u_init=1),
    ORR=struct(
      Nx=5,
      L=0.001,
      D_O2=1.0e-9,
      i0_ORR=80,
      E_act_ORR=40000,
      T_ref=298.15,
      alpha_c=0.5,
      c_O2_ref=1,
      c_O2_amb=1.2,
      k_gas=0.1,
      a_v=2000,
      c_init=repmat(1, 5, 1)),
    OER=struct(i0_OER=40, E_act_OER=50000, T_ref=298.15, alpha_a=0.5),
    H2=struct(i0_H2=0.05, E_act_H2=35000, T_ref=298.15, alpha_H2=0.5, A=0.01),
    Thermal=struct(
      Nx=1,
      L=0.01,
      k_th=5,
      rho=2000,
      cp=800,
      Vol=0.0001,
      h_conv=10,
      A_surf=0.02,
      T_amb=298.15,
      m_th=0.2,
      T_init=298.15)),
  MockData=struct(
    t_s=[0; 30; 60; 90; 120; 150; 180; 210; 240; 270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 3600],
    I_A=repmat(1, 121, 1),
    V_V=[0.9912776; 0.8181205; 0.8087744; 0.808715; 0.8089636; 0.8092044; 0.8094482; 0.8096791; 0.809899; 0.8101114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 0.8154999],
    SOC=[1; 0.9999996; 0.9999992; 0.9999987; 0.9999983; 0.9999979; 0.9999975; 0.9999971; 0.9999967; 0.9999962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 0.99995],
    CE=[0.999995; 0.999995; 0.999995; 0.9999949; 0.9999949; 0.9999949; 0.9999949; 0.9999949; 0.9999949; 0.9999948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 0.9999944],
    description="Synthetic Fe-air discharge mock from ironair_cell_step"))